# Grasshopper definition StairCase.gh (Grasshopper 1.0.7)
# plug-ins: Weaverbird, Kangaroo2 Components, MeshEdit Components, FemDesign.Grasshopper, Pufferfish, Human

cir = Circle(Plane=PlaneXY(0, 0, 0), Radius=Slider(7, range=3..7))
divide = DivideCurve(Curve=cir, Count=Slider(43, range=0..100), Kinks=False)  # -> Points, Tangents, Parameters
dup = DuplicateData(Data=divide.Points, Number=Slider(2, range=1..4), Order=True)
dom = ConstructDomain(DomainStart=0, DomainEnd=Slider(10, range=0.1..10))
lng = ListLength(List=dup)
range = Range(Domain=dom, Steps=expr("x-1", lng))
Z = UnitZ(Factor=range)
move = Move(Geometry=dup, Motion=Z)  # -> Geometry, Transform
bnd = Bounds(Numbers=range)
pdecon = Deconstruct(Point=move.Geometry)  # -> XComponent, YComponent, ZComponent
remap = RemapNumbers(Value=range, Source=bnd, Target=Domain(0, 1))  # -> Mapped, Clipped
pt = ConstructPoint(XCoordinate=0, YCoordinate=0, ZCoordinate=pdecon.ZComponent)
graph = GraphMapper(
    remap.Mapped,
    x0=0,
    x1=1,
    y0=0.3,
    y1=1.5,
    container_name="Bezier",
    cpx=[0, 0.8333333135, 0.4614434838, 1],
    cpy=[0.4382611513, 0.3840579987, 0.759164989, 0.4197104573])
scale = Scale(Geometry=move.Geometry, Center=pt, Factor=graph)  # -> Geometry, Transform
duppt = RemoveDuplicatePts(Points=move.Geometry, Tolerance=0.01)
pdecon_2 = Deconstruct(Point=duppt)  # -> XComponent, YComponent, ZComponent
panel = Panel(graph)
pt_2 = ConstructPoint(XCoordinate=0, YCoordinate=0, ZCoordinate=pdecon_2.ZComponent)
subtraction = Subtraction(A=panel, B=Slider(0.29, range=0..0.29))
scale_2 = Scale(Geometry=duppt, Center=pt_2, Factor=subtraction)  # -> Geometry, Transform
pt_3 = Point(scale.Geometry)
pline = PolyLine(Vertices=pt_3, Closed=False)

# ----
# Top Part
ln = Line(StartPoint=scale.Geometry, EndPoint=scale_2.Geometry)
meshloft = MeshLoft2(polys=ln)  # -> out, result; inputs polys: list of Polyline
# ---------- meshloft: C# ----------
    result = MeshLoft(polys);
# ---------- meshloft: C# additional code ----------
  //
  Mesh MeshLoft(IList<Polyline> polys)
  {
    if(Enumerable.All(polys, p => p.IsClosed))
      return MeshLoftClosed(polys);
    else
      return MeshLoftOpen(polys);
  }


  //
  Mesh MeshLoftOpen(IList<Polyline> polys)
  {
    Mesh result = new Mesh();
    var verts = result.Vertices;
    var faces = result.Faces;

    int ny = polys.Count;
    int nx = Enumerable.Min(polys, p => p.Count);
    int n;

    // add vertices
    for(int i = 0; i < ny; i++)
    {
      var poly = polys[i];

      for(int j = 0; j < nx; j++)
        verts.Add(poly[j]);
    }

    // add faces
    for(int i = 0; i < ny - 1; i++)
    {
      n = i * nx;

      for(int j = 0; j < nx - 1; j++)
        faces.AddFace(n + j, n + j + 1, n + j + nx + 1, n + j + nx);
    }

    return result;
  }


  //
  Mesh MeshLoftClosed(IList<Polyline> polys)
  {
    Mesh result = new Mesh();
    var verts = result.Vertices;
    var faces = result.Faces;

    int ny = polys.Count;
    int nx = Enumerable.Min(polys, p => p.Count) - 1;
    int n;

    // add vertices
    for(int i = 0; i < ny; i++)
    {
      var poly = polys[i];

      for(int j = 0; j < nx; j++)
        verts.Add(poly[j]);
    }

    // add faces
    for(int i = 0; i < ny - 1; i++)
    {
      n = i * nx;

      for(int j0 = 0; j0 < nx; j0++)
      {
        int j1 = (j0 + 1) % nx;
        faces.AddFace(n + j0, n + j1, n + j1 + nx, n + j0 + nx);
      }
    }

    return result;
  }
# ---------- end meshloft ----------
number_slider = Slider(1, range=1..3)
wbcatmullclark = WeaverbirdsCatmullClarkSubdivision(MeshCurves=meshloft.result, Level=number_slider, SmoothNakedEdges=0)
mesh = Mesh(wbcatmullclark)

# ----
# Inner Part
graph_2 = GraphMapper(
    remap.Mapped,
    x0=0,
    x1=1,
    y0=0.5,
    y1=3,
    container_name="Bezier",
    cpx=[0, 0.2391304374, 0.8594210148, 1],
    cpy=[0.2809377313, 0, 0.734782815, 0.2453206182])
pline_2 = PolyLine(Vertices=scale_2.Geometry, Closed=False)
Z_2 = UnitZ(Factor=expr("-x", graph_2))
move_2 = Move(Geometry=scale_2.Geometry, Motion=Z_2)  # -> Geometry, Transform
pline_3 = PolyLine(Vertices=move_2.Geometry, Closed=False)
meshloft_2 = MeshLoft(polyA=pline_2, polyB=pline_3)  # -> out, result; inputs polyA: Polyline, polyB: Polyline
# ---------- meshloft_2: C# ----------
    result = MeshLoft(polyA, polyB);
# ---------- meshloft_2: C# additional code ----------
  //
  Mesh MeshLoft(Polyline polyA, Polyline polyB)
  {
    if(polyA.IsClosed && polyB.IsClosed)
      return MeshLoftClosed(polyA, polyB);
    else
      return MeshLoftOpen(polyA, polyB);
  }


  //
  Mesh MeshLoftOpen(Polyline polyA, Polyline polyB)
  {
    Mesh result = new Mesh();
    var verts = result.Vertices;
    var faces = result.Faces;

    int n = polyA.Count;

    // add vertices
    verts.AddVertices(polyA);
    verts.AddVertices(polyB);

    // add faces
    for(int i = 0; i < n - 1; i++)
      faces.AddFace(i, i + 1, i + n + 1, i + n);
    
    return result;
  }


  //
  Mesh MeshLoftClosed(Polyline polyA, Polyline polyB)
  {
    Mesh result = new Mesh();
    var verts = result.Vertices;
    var faces = result.Faces;

    int n = polyA.Count - 1;

    verts.AddVertices(polyA.Skip(1));
    verts.AddVertices(polyB.Skip(1));

    // add faces
    for(int i = 0, j = 1; i < n; i++, j++)
    {
      if(j == n) j = 0;
      faces.AddFace(i, j, j + n, i + n);
    }
    
    return result;
  }
# ---------- end meshloft_2 ----------
wbcatmullclark_2 = WeaverbirdsCatmullClarkSubdivision(MeshCurves=meshloft_2.result, Level=number_slider, SmoothNakedEdges=0)
mesh_2 = Mesh(wbcatmullclark_2)

meshloft_3 = MeshLoft(polyA=pline, polyB=pline_3)  # -> out, result; inputs polyA: Polyline, polyB: Polyline; same code as meshloft_2
wbcatmullclark_3 = WeaverbirdsCatmullClarkSubdivision(MeshCurves=meshloft_3.result, Level=number_slider, SmoothNakedEdges=0)
mesh_3 = Mesh(wbcatmullclark_3)
mjoin = MeshJoin(Meshes=[mesh, mesh_2, mesh_3])

mesh_4 = Mesh(mjoin)
medges = MeshEdges(Mesh=mesh_4)  # -> NakedEdges, InteriorEdges, NonManifoldEdges
swatch = ColourSwatch(SwatchColor=RGB(27, 83, 143))
crv = Curve(medges.NakedEdges)
crv_2 = Curve(medges.InteriorEdges)
mcol = MeshColours(Mesh=mesh_4, Colours=ColourSwatch(SwatchColor=RGB(255, 255, 255)))
previewlw = CustomPreviewLineweights(Geometry=crv, Shader=swatch, Thickness="3", Absolute=False)
previewlw_2 = CustomPreviewLineweights(Geometry=crv_2, Shader=swatch, Thickness="3", Absolute=False)

path = FilePath("C:\Users\MarcoPellegrinoKonsu\AppData\Roaming\Grasshopper\Libraries\FemDesign\library\materials_GB.struxml")  # disabled
fromstruxml = MaterialDatabaseFromStruxml(FilePath=path)  # disabled
panel_3 = Panel("S 420")  # disabled
getmaterialbyname = MaterialGetMaterialByName(MaterialDatabase=fromstruxml, MaterialName=panel_3)  # disabled

toggle = BooleanToggle(True)  # disabled
panel_4 = Panel("0.60")  # disabled
triremesh = TriRemesh(Geometry=mjoin, Sharp=toggle, Length=panel_4, Iterations=25)  # -> Triangulation, Dual, Creases; disabled

mesh_5 = Mesh(triremesh.Triangulation)  # disabled
explode = MeshExplode(Mesh=mesh_5, Interpolate=False)  # disabled
wbfacepolys = WeaverbirdsFacePolylines(Mesh=explode)  # disabled
boundary = BoundarySurfaces(Edges=wbfacepolys)  # disabled
debrep = DeconstructBrep(Brep=boundary)  # -> Faces, Edges, Vertices; disabled
panel_5 = Panel("0.02")  # disabled
define = ThicknessDefine(Point=debrep.Vertices, Value=panel_5)  # -> simplify(Thickness); disabled
platevariable = SlabPlateVariableThickness(Surface=simplify(boundary), Thickness=define, Material=getmaterialbyname, Identifier="P")  # disabled

weldvertices = MeshWeldVertices(Mesh=mesh_5, Tolerance=0.01)  # -> RuntimeMessage, Mesh; disabled
nv = NakedVertices(Mesh=weldvertices.Mesh)  # -> ClothedIndex, NakedIndex, ClothedPts, NakedPts; disabled

panel_6 = Panel("dead_load")  # disabled
panel_7 = Panel("Crown")  # disabled
panel_8 = Panel("IL")  # disabled
panel_9 = Panel("DL")  # disabled
create = LoadCaseCreate(Name=panel_7, Type="static", DurationClass="permanent")  # disabled
create_2 = LoadCaseCreate(Name=panel_8, Type="static", DurationClass="permanent")  # disabled
create_3 = LoadCaseCreate(Name=panel_9, Type=panel_6, DurationClass="permanent")  # disabled
panel_10 = Panel("-1.00")  # disabled
Z_3 = UnitZ(Factor=panel_10)  # disabled
panel_11 = Panel("-4.00")  # disabled
Z_4 = UnitZ(Factor=panel_11)  # disabled
srf = Surface(boundary)  # disabled
uniform = SurfaceLoadUniform(Surface=srf, Force=Z_4, LoadCase=create)  # disabled
force = PointLoadForce(Point=nv.ClothedPts, Force=Z_3, LoadCase=create_2)  # disabled

pt_4 = Point(nv.NakedPts)  # disabled
rigid = PointSupportRigid(Point=pt_4, Identifier="S")  # disabled

panel_12 = Panel("0.60")  # disabled
avgsrfelemsize = SlabAverageSurfaceElementSize(Slab=platevariable, AverageSurfaceElementSize=panel_12)  # disabled

# ---- group: Assemble
data = Data(flatten([avgsrfelemsize, rigid]))  # disabled
data_2 = Data(flatten([force, uniform]))  # disabled
data_3 = Data(flatten([create_3, create_2, create]))  # disabled
create_4 = ModelCreateSimple(CountryCode="S", StructureElements=data, Loads=data_2, LoadCases=data_3)  # disabled

# ---- group: Run Analysis
define_2 = AnalysisDefine(
    CalcCase=Toggle(True),
    CalcCstage=False,
    CalcImpf=False,
    CalcComb=False,
    CalcGmax=False,
    CalcStab=False,
    CalcFreq=False,
    CalcSeis=False,
    CalcDesign=False,
    CalcFootfall=False,
    Elemfine=False,
    Diaphragm=False,
    PeakSmoothing=False)
python = GhPythonScript(filename="Stair.struxml")  # -> out, a
# ---------- python: Python ----------
import rhinoscriptsyntax as rs

try:
    a = rs.DocumentPath() + filename
except:
    ghenv.Component.AddMessageForWarnings ( "save your file")
# ---------- end python ----------
data_4 = Data(create_4)
runanalysis = ApplicationRunAnalysis(
    FdModel=data_4,
    FilePathStruxml=python.a,
    Analysis=define_2,
    ResultTypes="ShellDisplacement",
    EndSession=Toggle(True),
    CloseOpenWindows=Toggle(True),
    RunNode=Toggle(False))  # -> FdModel, FdFeaModel, Results, HasExited

# ----
shelldisplacement = ShellDisplacement(Result=runanalysis.Results, CaseCombinationName="IL")  # -> CaseIdentifier, ElementId, NodeId, Translation, Rotation
feashell = FdFeaModelFeaShell(FdFeaModel=runanalysis.FdFeaModel)  # -> Identifier, ElementId, FaceIndex, MeshGeometry
item = ListItem(List=shelldisplacement.Translation, Index="-1", Wrap=True)
vlen = VectorLength(Vector=item)  # -> flatten(Length)
values = Number(vlen)

num = Data(values)
bnd_2 = Bounds(Numbers=num)
remap_2 = RemapNumbers(Value=num, Source=bnd_2, Target=Domain(0, 1))  # -> Mapped, Clipped
clr = ColorsAlpaca4d(gradIndex=Slider(9, range=1..12))  # -> colors; inputs gradIndex: Int32
#   port colors: A series of colors to be plugged into the "Ladybug_Legend Parameters" component.
# ---------- clr: Python ----------
"""
Preset of gradient colors perfect for Data Visualisation
    Inputs:
        gradIndex: An index refering to one of the following possible gradients:
            0 - Orignal Ladybug
            1 - Nuanced Ladybug
            2 - Multi-colored Ladybug
            3 - Ecotect
            4 - Thermal Comfort Percentage
            5 - Thermal Comfort Colors
            6 - Shade Benefit/Harm
            7 - Shade Harm
            8 - Shade Benefit
            9 - CFD Colors 1
            10 - Radiation Benefit
            11 - Gsa10 Colour
            12 - Gsa9 Colour
    Returns:
        customColors: A series of colors.
"""

ghenv.Component.Name = "Colors (Alpaca4d)"
ghenv.Component.NickName = 'CLR'
ghenv.Component.Message = 'Colors (Alpaca4d)'

import scriptcontext as sc
import Grasshopper.Kernel as gh
import System

gradientLibrary = {
        0: [System.Drawing.Color.FromArgb(75, 107, 169), System.Drawing.Color.FromArgb(115, 147, 202), System.Drawing.Color.FromArgb(170, 200, 247), System.Drawing.Color.FromArgb(193, 213, 208), System.Drawing.Color.FromArgb(245, 239, 103), System.Drawing.Color.FromArgb(252, 230, 74), System.Drawing.Color.FromArgb(239, 156, 21), System.Drawing.Color.FromArgb(234, 123, 0), System.Drawing.Color.FromArgb(234, 74, 0), System.Drawing.Color.FromArgb(234, 38, 0)],
        1: [System.Drawing.Color.FromArgb(49,54,149), System.Drawing.Color.FromArgb(69,117,180), System.Drawing.Color.FromArgb(116,173,209), System.Drawing.Color.FromArgb(171,217,233), System.Drawing.Color.FromArgb(224,243,248), System.Drawing.Color.FromArgb(255,255,191), System.Drawing.Color.FromArgb(254,224,144), System.Drawing.Color.FromArgb(253,174,97), System.Drawing.Color.FromArgb(244,109,67), System.Drawing.Color.FromArgb(215,48,39), System.Drawing.Color.FromArgb(165,0,38)],
        2: [System.Drawing.Color.FromArgb(4,25,145), System.Drawing.Color.FromArgb(7,48,224), System.Drawing.Color.FromArgb(7,88,255), System.Drawing.Color.FromArgb(1,232,255), System.Drawing.Color.FromArgb(97,246,156), System.Drawing.Color.FromArgb(166,249,86), System.Drawing.Color.FromArgb(254,244,1), System.Drawing.Color.FromArgb(255,121,0), System.Drawing.Color.FromArgb(239,39,0), System.Drawing.Color.FromArgb(138,17,0)],
        3: [System.Drawing.Color.FromArgb(0,0,255), System.Drawing.Color.FromArgb(53,0,202), System.Drawing.Color.FromArgb(107,0,148), System.Drawing.Color.FromArgb(160,0,95), System.Drawing.Color.FromArgb(214,0,41), System.Drawing.Color.FromArgb(255,12,0), System.Drawing.Color.FromArgb(255,66,0), System.Drawing.Color.FromArgb(255,119,0), System.Drawing.Color.FromArgb(255,173,0), System.Drawing.Color.FromArgb(255,226,0), System.Drawing.Color.FromArgb(255,255,0)],
        4: [System.Drawing.Color.FromArgb(0,0,0), System.Drawing.Color.FromArgb(110,0,153), System.Drawing.Color.FromArgb(255,0,0), System.Drawing.Color.FromArgb(255,255,102), System.Drawing.Color.FromArgb(255,255,255)],
        5: [System.Drawing.Color.FromArgb(0,136,255), System.Drawing.Color.FromArgb(200,225,255), System.Drawing.Color.FromArgb(255,255,255), System.Drawing.Color.FromArgb(255,230,230), System.Drawing.Color.FromArgb(255,0,0)],
        6: [System.Drawing.Color.FromArgb(5,48,97), System.Drawing.Color.FromArgb(33,102,172), System.Drawing.Color.FromArgb(67,147,195), System.Drawing.Color.FromArgb(146,197,222), System.Drawing.Color.FromArgb(209,229,240), System.Drawing.Color.FromArgb(255,255,255), System.Drawing.Color.FromArgb(253,219,199), System.Drawing.Color.FromArgb(244,165,130), System.Drawing.Color.FromArgb(214,96,77), System.Drawing.Color.FromArgb(178,24,43), System.Drawing.Color.FromArgb(103,0,31)],
        7: [System.Drawing.Color.FromArgb(255,255,255), System.Drawing.Color.FromArgb(253,219,199), System.Drawing.Color.FromArgb(244,165,130), System.Drawing.Color.FromArgb(214,96,77), System.Drawing.Color.FromArgb(178,24,43), System.Drawing.Color.FromArgb(103,0,31)],
        8: [System.Drawing.Color.FromArgb(255,255,255), System.Drawing.Color.FromArgb(209,229,240), System.Drawing.Color.FromArgb(146,197,222), System.Drawing.Color.FromArgb(67,147,195), System.Drawing.Color.FromArgb(33,102,172), System.Drawing.Color.FromArgb(5,48,97)],
        9: [System.Drawing.Color.FromArgb(0,16,120), System.Drawing.Color.FromArgb(38,70,160), System.Drawing.Color.FromArgb(5,180,222), System.Drawing.Color.FromArgb(16,180,109), System.Drawing.Color.FromArgb(59,183,35), System.Drawing.Color.FromArgb(143,209,19), System.Drawing.Color.FromArgb(228,215,29), System.Drawing.Color.FromArgb(246,147,17), System.Drawing.Color.FromArgb(243,74,0), System.Drawing.Color.FromArgb(255,0,0)],
        10: [System.Drawing.Color.FromArgb(0,191,48), System.Drawing.Color.FromArgb(255,238,184), System.Drawing.Color.FromArgb(255,0,0)],
        11: [System.Drawing.Color.FromArgb(204,0,71), System.Drawing.Color.FromArgb(255,182,71), System.Drawing.Color.FromArgb(206,255,115), System.Drawing.Color.FromArgb(26,180, 214),System.Drawing.Color.FromArgb(0,0,207)],
        12: [System.Drawing.Color.FromArgb(255, 51, 51), System.Drawing.Color.FromArgb(255, 170, 51), System.Drawing.Color.FromArgb(255, 255, 51), System.Drawing.Color.FromArgb(170, 255, 125), System.Drawing.Color.FromArgb(51, 255, 231), System.Drawing.Color.FromArgb(51, 170, 255), System.Drawing.Color.FromArgb(51,51, 255)]}
colors = gradientLibrary[gradIndex]
# ---------- end clr ----------
twnthrucols = TweenThroughColors(
    Colors=clr,
    Factor=remap_2.Mapped,
    Normalized=True,
    Equalized=False,
    Weighted=False,
    Loopback=False,
    Degree=3,
    InterpolationType=0,
    Alpha=True)
col = Colour(twnthrucols)
col_2 = Data(col)

explode_2 = MeshExplode(Mesh=feashell.MeshGeometry, Interpolate=False)
graft = GraftTree(Tree=explode_2, IncludeEmptyLists=True, IncludeNullItems=True)
graft_2 = GraftTree(Tree=col_2, IncludeEmptyLists=True, IncludeNullItems=True)
mcol_2 = MeshColours(Mesh=graft, Colours=graft_2)
mjoin_2 = MeshJoin(Meshes=flatten(mcol_2))
